# Grasshopper definition Weaving.gh (Grasshopper 1.0.7)
# plug-ins: Mesh Pipe

boundingsize = Slider(100, range=0..100)
pipesegments = Slider(10, range=3..10)
crvdegree = Slider(3, range=0..3)
index = Slider(1, range=0..6)
piperadius = Slider(0.75, range=0..10)
density = Slider(22, range=10..100)
pipecaps = Slider(1, range=0..2)
density_2 = Slider(5, range=0..10)
height = Slider(3, range=0..25)
overall_size = Slider(100, range=0..100)
# Pointed Twill Weave
# (3-1)
# Not Working Perfectly
pt = Point(Point(0, 0, 0))
weavetype = GetInteger(
    index,
    AtLeast=1,
    AtMost=1,
    Maximum=6,
    Minimum=-2147483648,
    Prompt="0-6 // 0 Tabby Weave (1-1), 1=BasketWeave (2-2), 2=BasketWeave (4-4),  3=Twill (2-2), 4=Twill (3-1), 5=Satin (4-1), 6=Satin (6-1)",
    TreeAccess=False)
boundingsize_2 = GetInteger(boundingsize, AtLeast=1, AtMost=1, Maximum=100, Minimum=-2147483648, Prompt="Recommended 100", TreeAccess=False)
density_3 = GetInteger(
    density_2,
    AtLeast=1,
    AtMost=1,
    Maximum=2147483647,
    Minimum=-2147483648,
    Prompt="Max 12 (Higher values would crash)",
    TreeAccess=False)
height_2 = GetInteger(height, AtLeast=1, AtMost=1, Maximum=2147483647, Minimum=-2147483648, TreeAccess=False)
crvdegree_2 = GetInteger(crvdegree, AtLeast=1, AtMost=1, Maximum=4, Minimum=-2147483648, TreeAccess=False)
pipesegments_2 = GetInteger(pipesegments, AtLeast=1, AtMost=1, Maximum=2147483647, Minimum=3, TreeAccess=False)
pipecaps_2 = GetInteger(
    pipecaps,
    AtLeast=1,
    AtMost=1,
    Maximum=2,
    Minimum=-2147483648,
    Prompt="0 = no caps, 1 = flat caps, 2 = round caps",
    TreeAccess=False)
piperadius_2 = GetNumber(piperadius, AtLeast=1, AtMost=1, Maximum=1.797693135e+308, Minimum=-1.797693135e+308, TreeAccess=False)
rectangle = Rectangle(Plane=pt, XSize=overall_size, YSize=overall_size, Radius=0)  # -> Rectangle, Length
division = Division(A=density, B=2)
int = Integer(division)
int_2 = Integer(density)
sdivide = DivideSurface(Surface=rectangle.Rectangle, UCount=density, VCount=density)  # -> simplify(Points), Normals, Parameters
max = Maximum(A=piperadius_2, B="0.1")
max_2 = Maximum(A=pipesegments_2, B="3")
max_3 = Maximum(A=density_3, B="1")
min = Minimum(A=weavetype, B="6")
concat = Concatenate(FragmentA="{*;(", FragmentB=int, FragmentD=" to ", FragmentE=int_2, FragmentC=")}")
min_2 = Minimum(A=pipecaps_2, B="2")
min_3 = Minimum(A=crvdegree_2, B="4")
split = SplitTree(Data=sdivide.Points, Masks=flatten(concat))  # -> Positive, Negative
min_4 = Minimum(A=max_3, B="12")
number_slider = Slider(0, range=0..4)
addition = Addition(A=division, B=1)
addition_2 = Addition(A=density, B=1)
addition_3 = Addition(A=division, B=1)
addition_4 = Addition(A=density, B=1)
series = Series(Start=Slider(3, range=0..4), Step=1, Count=addition_2)
series_2 = Series(Start=Slider(0, range=0..4), Step=1, Count=addition_3)
flip = FlipMatrix(Data=split.Negative)
flip_2 = FlipMatrix(Data=split.Positive)
series_3 = Series(Start=number_slider, Step=1, Count=addition)
series_4 = Series(Start=number_slider, Step=1, Count=addition)
series_5 = Series(Start=0, Step=1, Count=addition_4)
series_6 = Series(Start=0, Step=1, Count=addition_4)
neg = Negative(Value=series)
neg_2 = Negative(Value=series_2)
num = Number(min_3)
num_2 = Number(max_2)
num_3 = Number(min)
num_4 = Number(boundingsize_2)
num_5 = Number(min_4)
num_6 = Number(height_2)
num_7 = Number(max)
num_8 = Number(min_2)
num_9 = Number(min)
num_10 = Number(boundingsize_2)
num_11 = Number(height_2)
num_12 = Number(min_3)
num_13 = Number(max)
num_14 = Number(min_4)
num_15 = Number(max_2)
num_16 = Number(min_2)
height_3 = Slider(3, range=0..25)
height_4 = Slider(3, range=0..25)
shift = ShiftList(List=split.Negative, Shift=graft(neg_2), Wrap=True)  # -> simplify(List)
shift_2 = ShiftList(List=split.Negative, Shift=graft(neg_2), Wrap=True)  # -> simplify(List)
shift_3 = ShiftList(List=flip, Shift=graft(neg), Wrap=True)  # -> simplify(List)
shift_4 = ShiftList(List=flip, Shift=graft(neg), Wrap=True)  # -> simplify(List)
panel = Panel("""True
False
False
False""")
panel_2 = Panel("""False
True
True
True""")
shift_5 = ShiftList(List=split.Positive, Shift=graft(series_3), Wrap=True)  # -> simplify(List)
shift_6 = ShiftList(List=split.Positive, Shift=graft(series_4), Wrap=True)  # -> simplify(List)
shift_7 = ShiftList(List=flip_2, Shift=graft(series_5), Wrap=True)  # -> simplify(List)
shift_8 = ShiftList(List=flip_2, Shift=graft(series_6), Wrap=True)  # -> simplify(List)
panel_3 = Panel("""True
False
False
False""")
panel_4 = Panel("""False
True
True
True""")
Z = UnitZ(Factor=height_3)
Z_2 = UnitZ(Factor=height_4)

# ----
# Tabby  Basket Weave
_0_plain_tabby_weave = Panel("""True
False""")
_1_basket_weave_2_2 = Panel("""True
True
False
False""")
_2_basket_weave_4_4 = Panel("""True
True
True
True
False
False
False
False""")
multiplication = Multiplication(A=num_5, B=4)
filter = StreamFilter(Gate=num_3, Stream0=_0_plain_tabby_weave, Stream1=_1_basket_weave_2_2, Stream2=_2_basket_weave_4_4)
rectangle_2 = Rectangle(Plane=PlaneXY(0, 0, 0), XSize=num_4, YSize=num_4, Radius=0)  # -> Rectangle, Length
not = GateNot(A=filter)
sdivide_2 = DivideSurface(Surface=rectangle_2.Rectangle, UCount=multiplication, VCount=multiplication)  # -> Points, Normals, Parameters
flip_3 = FlipMatrix(Data=sdivide_2.Points)
Z_3 = UnitZ(Factor=num_6)
cull = CullPattern(List=sdivide_2.Points, CullPattern=filter)
cull_2 = CullPattern(List=sdivide_2.Points, CullPattern=not)
cull_3 = CullPattern(List=sdivide_2.Points, CullPattern=filter)
cull_4 = CullPattern(List=sdivide_2.Points, CullPattern=not)
cull_5 = CullPattern(List=flip_3, CullPattern=filter)
cull_6 = CullPattern(List=flip_3, CullPattern=not)
cull_7 = CullPattern(List=flip_3, CullPattern=filter)
cull_8 = CullPattern(List=flip_3, CullPattern=not)
neg_3 = Negative(Value=Z_3)
move = Move(Geometry=cull, Motion=neg_3)  # -> Geometry, Transform
move_2 = Move(Geometry=cull_2, Motion=Z_3)  # -> Geometry, Transform
move_3 = Move(Geometry=cull_3, Motion=Z_3)  # -> Geometry, Transform
move_4 = Move(Geometry=cull_4, Motion=neg_3)  # -> Geometry, Transform
move_5 = Move(Geometry=cull_5, Motion=Z_3)  # -> Geometry, Transform
move_6 = Move(Geometry=cull_6, Motion=neg_3)  # -> Geometry, Transform
move_7 = Move(Geometry=cull_7, Motion=neg_3)  # -> Geometry, Transform
move_8 = Move(Geometry=cull_8, Motion=Z_3)  # -> Geometry, Transform
weave = Weave(Pattern=not, Stream0=move.Geometry, Stream1=move_2.Geometry, NullGaps=False)
weave_2 = Weave(Pattern=not, Stream0=move_3.Geometry, Stream1=move_4.Geometry, NullGaps=False)
weave_3 = Weave(Pattern=not, Stream0=move_7.Geometry, Stream1=move_8.Geometry, NullGaps=False)
weave_4 = Weave(Pattern=not, Stream0=move_5.Geometry, Stream1=move_6.Geometry, NullGaps=False)
not_2 = GateNot(A=filter)
intcrv = Interpolate(Vertices=weave, Degree=num, Periodic=False, KnotStyle=1)  # -> Curve, Length, Domain
intcrv_2 = Interpolate(Vertices=weave_2, Degree=num, Periodic=False, KnotStyle=1)  # -> Curve, Length, Domain
intcrv_3 = Interpolate(Vertices=weave_4, Degree=num, Periodic=False, KnotStyle=1)  # -> Curve, Length, Domain
intcrv_4 = Interpolate(Vertices=weave_3, Degree=num, Periodic=False, KnotStyle=1)  # -> Curve, Length, Domain
cull_9 = CullPattern(List=flatten(intcrv.Curve), CullPattern=filter)
cull_10 = CullPattern(List=flatten(intcrv_2.Curve), CullPattern=not_2)
cull_11 = CullPattern(List=flatten(intcrv_3.Curve), CullPattern=filter)
cull_12 = CullPattern(List=flatten(intcrv_4.Curve), CullPattern=not_2)
mpipe = MeshPipe(Curve=cull_11, Radius=num_7, Accuracy=0.2, Rotation=0, Segments=num_2, Caps=num_8)
mpipe_2 = MeshPipe(Curve=cull_12, Radius=num_7, Accuracy=0.2, Rotation=0, Segments=num_2, Caps=num_8)
mpipe_3 = MeshPipe(Curve=cull_10, Radius=num_7, Accuracy=0.2, Rotation=0, Segments=num_2, Caps=num_8)
mpipe_4 = MeshPipe(Curve=cull_9, Radius=num_7, Accuracy=0.2, Rotation=0, Segments=num_2, Caps=num_8)
mcol = MeshColours(Mesh=mpipe, Colours="cyan")
mcol_2 = MeshColours(Mesh=mpipe_3, Colours="red")
mcol_3 = MeshColours(Mesh=mpipe_2, Colours="blue")
mcol_4 = MeshColours(Mesh=mpipe_4, Colours="pink")
mjoin = MeshJoin(Meshes=flatten([mcol_4, mcol_2, mcol, mcol_3]))

filter_2 = StreamFilter(Gate=num_9, Stream3="0", Stream4="1", Stream5="3", Stream6="4")
neg_4 = Negative(Value=Z)
neg_5 = Negative(Value=Z_2)
cull_13 = CullPattern(List=shift, CullPattern=panel)
cull_14 = CullPattern(List=shift_2, CullPattern=panel_2)
cull_15 = CullPattern(List=shift_3, CullPattern=panel_2)
cull_16 = CullPattern(List=shift_4, CullPattern=panel)
cull_17 = CullPattern(List=shift_5, CullPattern=panel_3)
cull_18 = CullPattern(List=shift_6, CullPattern=panel_4)
cull_19 = CullPattern(List=shift_7, CullPattern=panel_4)
cull_20 = CullPattern(List=shift_8, CullPattern=panel_3)
move_9 = Move(Geometry=cull_13, Motion=Z)  # -> Geometry, Transform
move_10 = Move(Geometry=cull_14, Motion=neg_4)  # -> Geometry, Transform
move_11 = Move(Geometry=cull_15, Motion=Z)  # -> Geometry, Transform
move_12 = Move(Geometry=cull_16, Motion=neg_4)  # -> Geometry, Transform
_5_satin_4_1 = Panel("""True
False
False
False
False
False""")
move_13 = Move(Geometry=cull_17, Motion=Z_2)  # -> Geometry, Transform
move_14 = Move(Geometry=cull_18, Motion=neg_5)  # -> Geometry, Transform
move_15 = Move(Geometry=cull_19, Motion=Z_2)  # -> Geometry, Transform
move_16 = Move(Geometry=cull_20, Motion=neg_5)  # -> Geometry, Transform
_6_satin_6_1 = Panel("""True
False
False
False
False
False
False""")
merge = Merge(Data1=move_9.Geometry, Data2=move_10.Geometry)
merge_2 = Merge(Data1=move_11.Geometry, Data2=move_12.Geometry)
merge_3 = Merge(Data1=move_13.Geometry, Data2=move_14.Geometry)
merge_4 = Merge(Data1=move_15.Geometry, Data2=move_16.Geometry)
_6_satin_6_1_2 = Panel("""False
False
False
True
False
False
False""")
pdecon = Deconstruct(Point=merge)  # -> XComponent, YComponent, ZComponent
pdecon_2 = Deconstruct(Point=merge_2)  # -> XComponent, YComponent, ZComponent
pdecon_3 = Deconstruct(Point=merge_3)  # -> XComponent, YComponent, ZComponent
pdecon_4 = Deconstruct(Point=merge_4)  # -> XComponent, YComponent, ZComponent
sort = SortList(Keys=pdecon.YComponent, ValuesA=merge)  # -> Keys, ValuesA
sort_2 = SortList(Keys=pdecon_2.XComponent, ValuesA=merge_2)  # -> Keys, ValuesA
sort_3 = SortList(Keys=pdecon_3.YComponent, ValuesA=merge_3)  # -> Keys, ValuesA
sort_4 = SortList(Keys=pdecon_4.XComponent, ValuesA=merge_4)  # -> Keys, ValuesA
number_slider_2 = Slider(3, range=0..3)
merge_5 = Merge(Data1=sort.ValuesA, Data2=sort_3.ValuesA)
merge_6 = Merge(Data1=sort_2.ValuesA, Data2=sort_4.ValuesA)
intcrv_5 = Interpolate(Vertices=sort_3.ValuesA, Degree=number_slider_2, Periodic=False, KnotStyle=1)  # -> Curve, Length, Domain
intcrv_6 = Interpolate(Vertices=merge_6, Degree=number_slider_2, Periodic=False, KnotStyle=1)  # -> Curve, Length, Domain
intcrv_7 = Interpolate(Vertices=sort.ValuesA, Degree=number_slider_2, Periodic=False, KnotStyle=1)  # -> Curve, Length, Domain
ccx = CurveCurve(CurveA=intcrv_5.Curve, CurveB=intcrv_6.Curve)  # -> Points, ParamsA, ParamsB
preview = CustomPreview(Geometry=ccx.Points, Material=ColourSwatch(SwatchColor=RGB(0, 255, 204)))
pipe_radius = Slider(1.5, range=0..10)
num_17 = Number(min)
smaller = SmallerThan(FirstNumber=num_17, SecondNumber="3")  # -> SmallerThan, OrEqualTo
pipe = Pipe(Curve=[intcrv_6.Curve, intcrv_5.Curve, intcrv_7.Curve], Radius=pipe_radius, Caps=0)
preview_2 = CustomPreview(Geometry=pipe, Material=ColourSwatch(SwatchColor=RGB(255, 255, 255)))

# ----
# Twill / Satin
_3_twill_2_2 = Panel("""True
True
False
False""")
_4_twill_3_1 = Panel("""True
False
False
False""")
rectangle_3 = Rectangle(Plane=PlaneXY(0, 0, 0), XSize=num_10, YSize=num_10, Radius=0)  # -> Rectangle, Length
multiplication_2 = Multiplication(A=num_14, B="4")
addition_5 = Addition(A=multiplication_2, B=1)
addition_6 = Addition(A=multiplication_2, B=1)
sdivide_3 = DivideSurface(Surface=rectangle_3.Rectangle, UCount=multiplication_2, VCount=multiplication_2)  # -> simplify(Points), Normals, Parameters
series_7 = Series(Start=0, Step=1, Count=addition_6)
series_8 = Series(Start=filter_2, Step=1, Count=addition_5)
filter_3 = StreamFilter(Gate=num_9, Stream3=_3_twill_2_2, Stream4=_4_twill_3_1, Stream5=_5_satin_4_1, Stream6=_6_satin_6_1)
flip_4 = FlipMatrix(Data=sdivide_3.Points)
shift_9 = ShiftList(List=sdivide_3.Points, Shift=graft(series_8), Wrap=True)  # -> simplify(List)
shift_10 = ShiftList(List=flip_4, Shift=graft(series_7), Wrap=True)  # -> simplify(List)
Z_4 = UnitZ(Factor=num_11)
neg_6 = Negative(Value=Z_4)
cull_21 = CullPattern(List=shift_9, CullPattern=filter_3)
move_17 = Move(Geometry=cull_21, Motion=Z_4)  # -> Geometry, Transform
num_18 = Number(min)

filter_4 = StreamFilter(Gate=num_9, Stream3=_3_twill_2_2, Stream4=_4_twill_3_1, Stream5=_5_satin_4_1, Stream6=_6_satin_6_1_2)
not_3 = GateNot(A=filter_4)
not_4 = GateNot(A=filter_3)
smaller_2 = SmallerThan(FirstNumber=num_18, SecondNumber="3")  # -> SmallerThan, OrEqualTo

cull_22 = CullPattern(List=shift_10, CullPattern=not_3)
cull_23 = CullPattern(List=shift_10, CullPattern=filter_4)
cull_24 = CullPattern(List=shift_9, CullPattern=not_4)
move_18 = Move(Geometry=cull_24, Motion=neg_6)  # -> Geometry, Transform
move_19 = Move(Geometry=cull_22, Motion=Z_4)  # -> Geometry, Transform
move_20 = Move(Geometry=cull_23, Motion=neg_6)  # -> Geometry, Transform
merge_7 = Merge(Data1=move_19.Geometry, Data2=move_20.Geometry)
merge_8 = Merge(Data1=move_17.Geometry, Data2=move_18.Geometry)
pdecon_5 = Deconstruct(Point=merge_8)  # -> XComponent, YComponent, ZComponent
pdecon_6 = Deconstruct(Point=merge_7)  # -> XComponent, YComponent, ZComponent
sort_5 = SortList(Keys=pdecon_5.YComponent, ValuesA=merge_8)  # -> Keys, ValuesA
sort_6 = SortList(Keys=pdecon_6.XComponent, ValuesA=merge_7)  # -> Keys, ValuesA
filter_5 = StreamFilter(Gate=smaller_2.SmallerThan, Stream0=sort_6.ValuesA)
intcrv_8 = Interpolate(Vertices=filter_5, Degree=num_12, Periodic=False, KnotStyle=1)  # -> Curve, Length, Domain
mpipe_5 = MeshPipe(Curve=intcrv_8.Curve, Radius=num_13, Accuracy=0.2, Rotation=0, Segments=num_15, Caps=num_16)
mcol_5 = MeshColours(Mesh=mpipe_5, Colours="blue")

filter_6 = StreamFilter(Gate=smaller.SmallerThan, Stream0=sort_5.ValuesA)

intcrv_9 = Interpolate(Vertices=filter_6, Degree=num_12, Periodic=False, KnotStyle=1)  # -> Curve, Length, Domain
mpipe_6 = MeshPipe(Curve=intcrv_9.Curve, Radius=num_13, Accuracy=0.2, Rotation=0, Segments=num_15, Caps=num_16)
mcol_6 = MeshColours(Mesh=mpipe_6, Colours="cyan")
mjoin_2 = MeshJoin(Meshes=flatten([mcol_6, mcol_5]))

# ----
# Error Check
# For Curve
# Intersections
swatch = ColourSwatch(SwatchColor=RGB(255, 0, 0))
ccx_2 = CurveCurve(CurveA=intcrv_9.Curve, CurveB=intcrv_8.Curve)  # -> Points, ParamsA, ParamsB
preview_3 = CustomPreview(Geometry=ccx_2.Points, Material=swatch)

mesh = Mesh([mjoin, mjoin_2])
null = NullItem(Item=mesh)  # -> NullFlags, InvalidFlags, Description
dispatch = Dispatch(List=mesh, DispatchPattern=null.NullFlags)  # -> ListA, ListB
mesh_2 = Mesh(dispatch.ListB)
context_bake = ContextBake(Geometry=mesh_2)
