# Grasshopper definition test.gh (Grasshopper 1.0.7)
# plug-ins: RhinoCodePluginGH

get_integer = GetInteger(Slider(2, range=0..10), AtLeast=1, AtMost=1, Maximum=2147483647, Minimum=-2147483648, TreeAccess=False)
get_integer_2 = GetInteger(Slider(2, range=0..10), AtLeast=1, AtMost=1, Maximum=2147483647, Minimum=-2147483648, TreeAccess=False)
S = Script(x=get_integer, y=get_integer_2)  # -> out, a
# ---------- S: Python ----------
"""Grasshopper Script"""
a = x + y
print(a)
# ---------- end S ----------
context_print = ContextPrint(Text=S.a)
